# Grasshopper definition deck.gh (Grasshopper 1.0.4)

number_slider = Slider(5.5, range=0..10)
number_slider_2 = Slider(31, range=0..100)
multiplication = Multiplication(A=number_slider, B=number_slider_2)
subtraction = Subtraction(A=number_slider_2, B=Slider(1, range=0..1))
pt = Point(Point(0, 0, 0))
X = UnitX(Factor=Slider(10, range=0..10))
subtraction_2 = Subtraction(A=Slider(193, range=0..1000), B=multiplication)
move = Move(Geometry=pt, Motion=X)  # -> Geometry, Transform
Y = UnitY(Factor=Slider(8, range=0..10))
random = Random(Range=Domain(0, 1), Number=subtraction, Seed=2)
ma = MassAddition(Input=random)  # -> Result, PartialResults
division = Division(A=subtraction_2, B=ma.Result)
series = Series(Start=0, Step=number_slider, Count=number_slider_2)
move_2 = Move(Geometry=move.Geometry, Motion=Y)  # -> Geometry, Transform
multiplication_2 = Multiplication(A=division, B=random)
ma_2 = MassAddition(Input=multiplication_2)  # -> Result, PartialResults
addition = Addition(B=multiplication_2)
ins = InsertItems(List=addition, Item=Slider(0, range=0..100), Indices=Slider(0, range=0..100), Wrap=True)
addition_2 = Addition(A=series, B=ins)
X_2 = UnitX(Factor=addition_2)
sort = SortList(Keys=addition)  # -> Keys, ValuesA
move_3 = Move(Geometry=move_2.Geometry, Motion=X_2)  # -> Geometry, Transform
Y_2 = UnitY(Factor=Slider(165, range=0..1000))
move_4 = Move(Geometry=move_3.Geometry, Motion=Y_2)  # -> Geometry, Transform
ln = Line(StartPoint=move_3.Geometry, EndPoint=move_4.Geometry)
X_3 = UnitX(Factor=number_slider)
move_5 = Move(Geometry=ln, Motion=X_3)  # -> Geometry, Transform
entwine = Entwine(Branch00=ln, Branch01=move_5.Geometry, FlattenInputs=True)
flip = FlipMatrix(Data=entwine)
loft = Loft(Curves=flip, Options={Adjust=False, Closed=False, LoftEnds=0, LoftSimp=0, LoftType=0, Rebuild=10, Refit=0.01})
